# Dynamo graph 4_11_Добавить_параметры_в_семейства.dyn "4.11_Добавить параметры в семейства" (Dynamo 2.6.1.8786)

retry = BoolSelector(true)  # graph input

# group: Выбираем путь к папке с семействами (не должен содержать вложенных папок)
directory_path = Directory("C:\1 ИНЖИНИРИНГ\ОБЪЕКТЫ\Канатная 122\E000\Категории 21\folder for add shared parameters")

параметры = StringInput("""БУДОВА_Позиция_Текст(БУДОВА_01. Универсальные параметры,TEXT,PG_DATA,0)
БУДОВА_Наименование(БУДОВА_01. Универсальные параметры,TEXT,PG_DATA,0)
БУДОВА_Артикул(БУДОВА_01. Универсальные параметры,TEXT,PG_DATA,0)
БУДОВА_Паспортный код изделия(БУДОВА_01. Универсальные параметры,TEXT,PG_DATA,0)
БУДОВА_Производитель(БУДОВА_01. Универсальные параметры,TEXT,PG_DATA,0)
БУДОВА_Единица измерения(БУДОВА_01. Универсальные параметры,TEXT,PG_DATA,0)
БУДОВА_Масса(БУДОВА_01. Универсальные параметры,MASS,PG_DATA,0)
БУДОВА_Масса_Текст(БУДОВА_01. Универсальные параметры,TEXT,PG_DATA,0)
БУДОВА_Примечание(БУДОВА_01. Универсальные параметры,TEXT,PG_DATA,0)
БУДОВА_Порядковый номер(БУДОВА_01. Универсальные параметры,NUMBER,PG_DATA,0)
БУДОВА_Количество листов(БУДОВА_03. Информация о проекте и листы,NUMBER,PG_DATA,0)
БУДОВА_Количество фаз(БУДОВА_ЭЛ_Основные,NOOFPOLES,PG_ELECTRICAL,0)
БУДОВА_Активная мощность(БУДОВА_ЭЛ_Основные,DUT_WATTS,PG_ELECTRICAL_LOADS,0)
БУДОВА_Классификация нагрузок(БУДОВА_ЭЛ_Основные,LOADCLASSIFICATION,PG_ELECTRICAL_LOADS,0)
БУДОВА_Коэффициент мощности(БУДОВА_ЭЛ_Основные,NUMBER,PG_ELECTRICAL_LOADS,0)
БУДОВА_Напряжение(БУДОВА_ЭЛ_Основные,ELECTRICAL_POTENTIAL,PG_ELECTRICAL_LOADS,0)
БУДОВА_Полная мощность(БУДОВА_ЭЛ_Основные,ELECTRICAL_APPARENT_POWER,PG_ELECTRICAL_LOADS,0)
БУДОВА_Принадлежность(БУДОВА_01. Универсальные параметры,TEXT,PG_TEXT,1)
БУДОВА_Обозначение(БУДОВА_01. Универсальные параметры,TEXT,PG_TEXT,1)
""")  # graph input

# group: work
python_script = Python(IN[0]=retry, IN[1]=directory_path, IN[2]=параметры)
# ---------- python_script.python (181 lines) ----------
import clr
import sys
pyt_path = r'C:\Program Files (x86)\IronPython 2.7\Lib'
sys.path.append(pyt_path)
import os
import System
clr.AddReference('ProtoGeometry')
from Autodesk.DesignScript.Geometry import *
clr.AddReference("RevitServices")
import RevitServices
from RevitServices.Persistence import DocumentManager
from RevitServices.Transactions import TransactionManager
clr.AddReference("RevitAPI")
import Autodesk
from Autodesk.Revit.DB import *
curdoc = DocumentManager.Instance.CurrentDBDocument
uiapp = DocumentManager.Instance.CurrentUIApplication
app = uiapp.Application
from System.Collections.Generic import *
clr.AddReference("RevitNodes")
import sys
import os
import Revit
clr.ImportExtensions(Revit.Elements)
import System
try:
	fop = app.OpenSharedParameterFile()
except:
	message = "No Shared Parameter file found."
	pass			
def ParamBindingExists(_doc, _paramName, _paramType):
	map = curdoc.ParameterBindings
	iterator = map.ForwardIterator()
	iterator.Reset()
	while iterator.MoveNext():
		if iterator.Key != None and iterator.Key.Name == _paramName and iterator.Key.ParameterType == _paramType:
			paramExists = True
			break
		else:
			paramExists = False
	return paramExists

def RemoveParamBinding(_doc, _paramName, _paramType):
	map = curdoc.ParameterBindings
	iterator = map.ForwardIterator()
	iterator.Reset()
	while iterator.MoveNext():
		if iterator.Key != None and iterator.Key.Name == _paramName and iterator.Key.ParameterType == _paramType:
			definition = iterator.Key
			break
	message = None
	if definition != None:
		map.Remove(definition)
		message = "Success"
	return message
	
def addParam(doc, _paramName, _visible, _instance, _groupName, _paramGroup,k):
	message = None
	if ParamBindingExists(doc, _paramName, _paramType):
		if not RemoveParamBinding(doc, _paramName, _paramType) == "Success":
			message = "Param Binding Not Removed Successfully"
		else:
			message = None	
	group = fop.Groups.get_Item(_groupName)
	cats = app.Create.NewCategorySet()
	#c = doc.FamilyCategory
	d = doc.Settings.Categories.get_Item(BuiltInCategory.OST_MechanicalEquipment)
	cats.Insert(d)
	if _instance=="1":
		bind = app.Create.NewInstanceBinding(cats)
	else:
		bind = app.Create.NewTypeBinding(cats)
	if group == None:
		group = fop.Groups.Create(_groupName)
	if group.Definitions.Contains(group.Definitions.Item[_paramName]):
		_def = group.Definitions.Item[_paramName]
	else:
   		_def = group.Definitions.Create(opt)
	return _def
	
_paramName = []
_groupName = []
_paramType = []
_paramType2 = []
_category = []
_category2 = []
_paramGroup = []
_paramGroup2 = []
_instance = []
parameters = IN[2].split("\n")
for parameter in parameters:
	try:
		if parameter is not None and parameter != "":
			paramName = parameter[:parameter.find("(")]
			_paramName.append(paramName)
			attrib = parameter[parameter.find("(")+1:parameter.find(")")+1]
			groupName = attrib[:attrib.find(",")]
			attrib = attrib[attrib.find(",")+1:]
			_groupName.append(groupName)
			paramType = attrib[:attrib.find(",")]
			attrib = attrib[attrib.find(",")+1:]
			_paramType2.append(paramType)
			paramGroup = attrib[:attrib.find(",")]
			attrib = attrib[attrib.find(",")+1:]
			_paramGroup2.append(paramGroup)
			instance = attrib[:attrib.find(",")]
			attrib = attrib[attrib.find(",")+1:]
			_instance.append(int(float(instance)))
	except:
		a=0	
types=System.Enum.GetValues(ParameterType)
for i in _paramType2:
	l=0
	for type in types:
		j = type.ToString()
		if i==j:
			_paramType.append(type)
			l=l+1
	if l==0:
		for type in types:
			j=type.ToString()
			if j=="Text":
				_paramType.append(type)	
groups=System.Enum.GetValues(BuiltInParameterGroup)
name=[]
for i in _paramGroup2:
	for group in groups:
		j = group.ToString()
		if j==i:
			_paramGroup.append(group)					
dir1 = IN[1]
files = os.listdir(dir1)
file=[]
for f in files:
	if ".rfa" in f and f[-9:-6]!='.00':
		file.append(f)					

mygroups = curdoc.Application.OpenSharedParameterFile().Groups
comment1 = ""
comment2 = []
list=[]
i=0
while i<file.Count:
	doc = app.OpenDocumentFile(dir1+ "\\" +file[i])
	a1 = dir(doc)
	TransactionManager.Instance.EnsureInTransaction(doc)
	j=0
	a=0
	b=0
	while j<_paramName.Count:
		check=0
		try:
			pars = doc.FamilyManager.GetParameters()
			for p in pars:
				name = p.Definition.Name
				if name == _paramName[j]:
					par = p
					check=1	
		except:
			0
		if check == 0:	
			a=a+1
			comment1 = str(a)+" шт. параметров не было в Файле общих параметров, я их добавил :)"
			opt = ExternalDefinitionCreationOptions(_paramName[j], _paramType[j])
			opt.Visible = True
			par = addParam(doc, _paramName[j],1, _instance[j], _groupName[j], _paramGroup[j],j)
		try:
			par1 = doc.FamilyManager.AddParameter(par,_paramGroup[j],_instance[j])
			#if formula[j] is not None and formula[j]!='':
				#t = doc.FamilyManager.SetFormula(par1,formula[j])
		except:
			b=b+1
			#par1 = doc.FamilyManager.get_Parameter(par)
			#if formula[j] is not None and formula[j]!='':
				#t = doc.FamilyManager.SetFormula(par1,formula[j])	
		j=j+1
	comment2.append(str(b)+" шт. параметров присутствует в модели, я не смог их добавить :(")	
	TransactionManager.Instance.ForceCloseTransaction()
	doc.Close()
	i=i+1
OUT = comment1,comment2
# ----------------------------------------

# group: Заполните параметры Путь должен быть без кавычек
параметры_2 = StringInput("БУДОВА_Позиция_Текст(БУДОВА_01. Универсальные параметры,TEXT,PG_DATA,0)")  # graph input
путь_к_семействам = StringInput("C:\1 ИНЖИНИРИНГ\ОБЪЕКТЫ\Канатная 122\E000\Категории 21\folder for add shared parameters")  # graph input

# group: Заполните параметры
параметры_3 = StringInput("""Тестовый параметр(16.Тестовая группа,Text,PG_DATA,0)
Тестовый параметр2(16.Тестовая группа,Text,PG_TEXT,0)
ПараметрППП(16.Тестовая группа,Text,PG_DATA,1)""")  # graph input; frozen
путь_к_семействам_2 = StringInput("C:\Users\Александр\Desktop\test rfa")  # graph input; frozen

параметры_4 = StringInput("Имя параметра(Имя группы в ФОП,Тип данных в ФОП, Имя группирования в семействе,0=тип  1=экземпляр)")  # graph input; frozen

# group: Выбираем путь к семействам и python отфильтровывает файлы с .00 (бэкапы семейств)
directory_path_2 = Directory("C:\1 ИНЖИНИРИНГ\ОБЪЕКТЫ\Канатная 122\E000\Категории 21\folder for add shared parameters\Автомат 2р в боксе")  # frozen
directory_from_path = DirectoryObject(path=directory_path_2)
getDirectoryContents = FileSystem.GetDirectoryContents(directory=directory_from_path)
python_script_2 = Python(IN[0]=getDirectoryContents.files)
# ---------- python_script_2.python (6 lines) ----------
#---------------------Filter *.rfa files-------------------------
file=[]
for f in IN[0]:
	if ".rfa" in f and f[-9:-6]!='.00': #do not load backup files
		file.append(f)
OUT=file
# ----------------------------------------
