# Dynamo graph s4.4.3 Bulk Upgrade(смотри этот).dyn (Dynamo 2.10.1.3976)
# packages: Clockwork for Dynamo 1.x 1.34.0, Rhythm 2021.12.1

directory_path = Directory("O:\REVIT\2018\Families\Annotation")  # graph input
code_block = CodeBlock { "*.rfa"; }

# group: Clockwork Package
contents = Custom[Directory.Contents+](directoryPath=directory_path, searchString=code_block)  # package Clockwork for Dynamo 1.x; Unlike the built-in node Directory.Contents, this node browses a directory recursively and returns all relevant files contained in subfolders as well.

# group: Rhythm Package
ʳʰʸᵗʰᵐ_applications = Rhythm.Revit.Application.Applications.OpenDocumentFile(filePath=contents)
boolean = BoolSelector(true)  # graph input
ʳʰʸᵗʰᵐ_applications_2 = Rhythm.Revit.Application.Applications.CloseDocument(document=ʳʰʸᵗʰᵐ_applications, save=boolean)
