# Dynamo graph s4.4.3 bulkUpgradeRevitFiles.dyn (Dynamo 2.10.1.3976)
# packages: Rhythm 2020.1.24

directory_path = Directory("No file selected.")
directory_from_path = DirectoryObject(path=directory_path)
code_block = CodeBlock { "*.rvt"; }
getDirectoryContents = FileSystem.GetDirectoryContents(directory=directory_from_path, searchString=code_block)
ʳʰʸᵗʰᵐ_applications = Rhythm.Revit.Application.Applications.OpenDocumentFile(filePath=getDirectoryContents.files)
boolean = BoolSelector(true)
ʳʰʸᵗʰᵐ_applications_2 = Rhythm.Revit.Application.Applications.CloseDocument(document=ʳʰʸᵗʰᵐ_applications, save=boolean)
