# Dynamo graph calculationGroups.dyn (Dynamo 2.10.1.3976)

# note: модуль main нужно расположить в той же папке, что и этот файл Dynamo, тогда можно указывать не полный путь, а только имя модуля/файла
string = StringInput("1_shield.py")

# group: полный путь к файлу, если файл не расположен в той же папке что этот файл Dynamo
# note: здесь указан полный путь расположения файла main. Букву r перед строкой ставить не нужно (для невоспринятия спецсимволов)
string_2 = StringInput("D:\Андрей\Ревит\Курс Погружение в IronPython и Revit API\3 Базовые действия в Revit API\3.4  Основные виды геометрии в Revit API\3.4 Видео\main.py")  # frozen
file_from_path = FileObject(path=string_2)
readText = FileSystem.ReadText(file=file_from_path)
python_script_from_string = PythonStringNode(script=readText, IN[0]=file_from_path)  # IronPython2

# group: вставить путь к файлу Excel. Кавычки после вставки нужно удалить
путь_к_файлу_excel_для_вывода = StringInput("C:\1 ИНЖИНИРИНГ\ОБЪЕКТЫ\Рабочка Варненская, 9\Скрипты\078_09_calculation_groups.xlsx")  # "Путь к файлу Excel для вывода данных.String"

# group: получили имя текущего документа Dynamo и зменили расширение .dyn на .py
python_script = Python()  # IronPython2; unwired: IN[0]
# ---------- python_script.python (40 lines) ----------
"""
DYNAMOAPI: GET CURRENT WORKSPACE NAME
"""
__author__ = 'John Pierson - sixtysecondrevit@gmail.com'
__twitter__ = '@60secondrevit'
__github__ = '@sixtysecondrevit'
__version__ = '1.0.0'
"""
Using reflection we are able to obtain the current Dynamo instance from the Revit instance.
"""
# we need to import the common language runtime to be able to interact with Dynamo & Revit

# Importing Reference Modules
# CLR ( Common Language Runtime Module )
import clr
# Adding the DynamoRevitDS.dll module to work with the Dynamo API
clr.AddReference('DynamoRevitDS')
import Dynamo 

# access to the current Dynamo instance and workspace
dynamoRevit = Dynamo.Applications.DynamoRevit()
currentWorkspace = dynamoRevit.RevitDynamoModel.CurrentWorkspace

# Access current version of dynamo
version=dynamoRevit.RevitDynamoModel.Version

# checks version of dynamo and adjusts output according to version
if version.StartsWith("1."):
    
    # Gets file name which includes full path
    filename=currentWorkspace.FileName
    
    # Splits out file path to just file name
    OUT=filename.Split("\\")[-1].Replace(".dyn","")

elif version.StartsWith("2."):
    OUT=currentWorkspace.Name+".py"

else:
    OUT="Not supported"
# ----------------------------------------

# note: здесь получили текст скрипта  файла main редактируемого в VSCode
file_from_path_2 = FileObject(path=python_script)
readText_2 = FileSystem.ReadText(file=file_from_path_2)
boolean = BoolSelector(false)
python_script_from_string_2 = PythonStringNode(script=readText_2, IN[0]=file_from_path_2, IN[1]=boolean)  # IronPython2
code_block = CodeBlock(w=python_script_from_string_2) { w; }  # frozen

# group: вывод данных в Excel
now = DateTime.Now()
code_block_2 = CodeBlock { "dd.MM.yy_hhчmmм"; }
format = DateTime.Format(dateTime=now, format=code_block_2)
code_block_3 = CodeBlock { 0; }
boolean_2 = BoolSelector(true)
exportExcel = Data.ExportExcel(filePath=путь_к_файлу_excel_для_вывода, sheetName=format, startRow=code_block_3, startCol=code_block_3, data=code_block, overWrite=boolean_2)

type = Object.Type(obj=python_script_from_string_2)
code_block_4 = CodeBlock(a=python_script_from_string_2) { a["гр.18А"]; }
type_2 = Object.Type(obj=code_block_4)
code_block_5 = CodeBlock(w=python_script_from_string_2) { w; }
code_block_6 = CodeBlock(a=python_script_from_string_2) { a["гр.18А"]["356558"]; }
code_block_7 = CodeBlock(a=code_block_4) { a["356558"]; }
