# Dynamo graph without_calculation_dU.dyn (Dynamo 2.10.1.3976)

# group: полный путь к файлу, если файл не расположен в той же папке что этот файл Dynamo
# note: здесь указан полный путь расположения файла main. Букву r перед строкой ставить не нужно (для невоспринятия спецсимволов)
string = StringInput("D:\Андрей\Ревит\Курс Погружение в IronPython и Revit API\3 Базовые действия в Revit API\3.4  Основные виды геометрии в Revit API\3.4 Видео\main.py")  # frozen
file_from_path = FileObject(path=string)
readText = FileSystem.ReadText(file=file_from_path)
python_script_from_string = PythonStringNode(script=readText, IN[0]=file_from_path)  # IronPython2

# note: модуль main нужно расположить в той же папке, что и этот файл Dynamo, тогда можно указывать не полный путь, а только имя модуля/файла
string_2 = StringInput("dU выводы.py")  # frozen
# note: здесь получили текст скрипта  файла main редактируемого в VSCode
file_from_path_2 = FileObject(path=string_2)
readText_2 = FileSystem.ReadText(file=file_from_path_2)
boolean = BoolSelector(false)
python_script_from_string_2 = PythonStringNode(script=readText_2, IN[0]=file_from_path_2, IN[1]=boolean)  # IronPython2
type = Object.Type(obj=python_script_from_string_2)
извлечение_по_ключу_из_словаря = CodeBlock(a=python_script_from_string_2) { a["гр.8"]; }
извлечение_по_ключу_из_словаря_2 = CodeBlock(a=python_script_from_string_2) { a[1]["гр.6"]; }  # "извлечение по ключу из словаря вывод из нескольких словарей"

# group: вставить путь к файлу Excel. Кавычки после вставки нужно удалить
путь_к_файлу_excel_для_вывода = StringInput("C:\1 ИНЖИНИРИНГ\ОБЪЕКТЫ\Рабочка Варненская, 9\Скрипты\078_09_calculation dU.xlsx")  # "Путь к файлу Excel для вывода данных.String"

# group: dU стояков
# note: Есть группы, которые промаркированы "магистраль", но их нагрузка не светильник, а розетка. Нужно будет предусмотреть расчет силовых приемников. Такие группы исключаются в выборе магистралей по этажам - если группа магистралей не присутствует в списке групп светильников, то она исключается.
# Есть группы с магистралями, у которых нет стояков, такие группы нужно посчитать отдельно
python_script = Python()  # IronPython2; unwired: IN[0]
# ---------- python_script.python (92 lines) ----------
# -*- coding: utf-8 -*
# dU стояков
import clr
clr.AddReference('RevitAPI')
clr.AddReference('RevitServices')  # Работа с документом и транзакциями
from Autodesk.Revit import DB
from Autodesk.Revit.DB import FilteredElementCollector as FEC
from RevitServices.Persistence import DocumentManager as DM  # Менеджер документа

doc = DM.Instance.CurrentDBDocument # Получение файла документа

stoyak_light_sum_power = {}

for light in FEC(doc).OfCategory(DB.BuiltInCategory.OST_LightingFixtures).WhereElementIsNotElementType().ToElements():
    if light.get_Parameter(DB.BuiltInParameter.SKETCH_PLANE_PARAM):  # если рабочая плоскость не None (проверь строку)
        # мощность светильника
        parameter = doc.GetElement(light.GetTypeId()).LookupParameter('БУДОВА_Активная мощность')  # получили мощность светильника во внутренних единицах
        unit = parameter.GetUnitTypeId()
        power = DB.UnitUtils.ConvertFromInternalUnits(parameter.AsDouble(), unit)  # конвертировали мощность светильника во внешние единицы/как на экране пользователя
        # группа светильника
        # :key.rfind(".")
        group = light.LookupParameter('БУДОВА_Группа').AsString()  # получили имя группы
        # этаж светильника
        level = light.LookupParameter('БУДОВА_Уровень оборудования').AsString()  # получили уровень оборудования
    # мощность светильников по "группа.этаж"
        if group not in stoyak_light_sum_power:
            stoyak_light_sum_power[group] = [0.0]
    # просуммировали мощность в каждой "группе.этаже" перевели в кВт
        stoyak_sum = stoyak_light_sum_power[group].pop() + power / 1000  # просуммировали мощность в каждой группе.этаже, перевели в кВт
        stoyak_light_sum_power[group].append(stoyak_sum)
# OUT = stoyak_light_sum_power

# ПРОВЕРКА цепи в имени которых есть "гр", у которых классификация нагрузок не освещение
koef_circuit = 1.05  # коэффициент запаса на длину цепи

stoyak_group_sum_circuit = {}  # словарь сумм длин стояков по группам
stoyak_sechenie = {}
for el_circuit in FEC(doc).OfCategory(DB.BuiltInCategory.OST_ElectricalCircuit).ToElements():
    if not el_circuit.LookupParameter('БУДОВА_Классификация нагрузок').AsElementId().IntegerValue == -1:
        if doc.GetElement(el_circuit.LookupParameter('БУДОВА_Классификация нагрузок').AsElementId()).Name == 'Освещение':
            if 'гр' in el_circuit.Name:
                # circuit_cl.append(el_circuit.Name)
            # Будова_Этаж (str)
                # circuit_cl.append(el_circuit.LookupParameter('БУДОВА_Этаж').AsString())
            # БУДОВА_Признак цепи (str) отделили коэффициенты стояков от магистралей и линий 
                if 'стояк' in el_circuit.LookupParameter('БУДОВА_Признак цепи').AsString():
                    parameter = el_circuit.Parameter[DB.BuiltInParameter.RBS_ELEC_CIRCUIT_LENGTH_PARAM]  # Длина цепи полная
                    unit = parameter.GetUnitTypeId()
                    leng = DB.UnitUtils.ConvertFromInternalUnits(parameter.AsDouble(), unit)  # конвертировали длину цепи во внешние единицы/как на экране пользователя
                    leng_with_koef = koef_circuit * leng  # длина цепи с коэффициентом запаса
                    # Коэффициент длины для dU (не полная длина):
                    str_stoyak = el_circuit.LookupParameter('БУДОВА_Признак цепи').AsString()[:2]  # два первых символа для коэф длины при расчете dU
                    group_c = el_circuit.LookupParameter('БУДОВА_Группа').AsString()
                    # взяли глобальное имя группы (срезали все что после последней точки)
                    # group_c = group_c[:group_c.rfind(".")]
                    # :key.rfind(".")
                    if group_c not in stoyak_group_sum_circuit:
                        stoyak_group_sum_circuit[group_c] = [0]
                    stoyak_sum = stoyak_group_sum_circuit[group_c].pop() + ((float(str_stoyak[0] + '.' + str_stoyak[1]) / 1000) * leng_with_koef)
                    # Длина стояков для dU (коэффициент запаса и коэффициент из празнака цепи):
                    stoyak_group_sum_circuit[group_c].append(stoyak_sum)  # float(str_mag[0] + '.' + str_mag[1]) - это коэф получающийся из строки признака цепи
# OUT = stoyak_group_sum_circuit

                # Тип кабеля (str) (ВВГнг 3х2,5)
                    type_cbel = doc.GetElement(el_circuit.LookupParameter('Тип кабеля').AsElementId()).Name
                # Сечение кабеля (str) Ищет 'х' на русском. Заменили запятую на точку. Перевели в число (пример: 2.5)
                    el = type_cbel.rfind('х') + 1
                    if el != -1:
                        if group_c not in stoyak_sechenie:
                            stoyak_sechenie[group_c] = []
                        stoyak_sechenie[group_c].append(float(type_cbel[el:].replace(',', '.')))
# OUT = stoyak_sechenie

moment_stoyakov = {}
dU_stoyakov = {}
for key in stoyak_group_sum_circuit.keys():
    if key in stoyak_light_sum_power:
        if key not in dU_stoyakov:
            dU_stoyakov[key] = []
        dU_stoyakov[key].append((stoyak_light_sum_power[key][0] * stoyak_group_sum_circuit[key][0]) / 12 / stoyak_sechenie[key][0])
        if key not in moment_stoyakov:
            moment_stoyakov[key] = []
        moment_stoyakov[key].append(stoyak_light_sum_power[key][0] * stoyak_group_sum_circuit[key][0])
# из списка стояков/цепей

# OUT = moment_stoyakov
# OUT = dU_stoyakov
# # # OUT = circuit_cl
# # # OUT = stoyak_light_sum_power
# # # OUT = stoyak_group_sum_circuit

OUT = dU_stoyakov, moment_stoyakov
# ----------------------------------------

# group: максимальные dU магистралей по этажам
python_script_2 = Python()  # IronPython2; unwired: IN[0]
# ---------- python_script_2.python (127 lines) ----------
# -*- coding: utf-8 -*
# dU магистралей по этажам
import clr
clr.AddReference('RevitAPI')
clr.AddReference('RevitServices')  # Работа с документом и транзакциями
from Autodesk.Revit import DB
from Autodesk.Revit.DB import FilteredElementCollector as FEC
from RevitServices.Persistence import DocumentManager as DM  # Менеджер документа

doc = DM.Instance.CurrentDBDocument # Получение файла документа

mag_light_sum_power = {}

for light in FEC(doc).OfCategory(DB.BuiltInCategory.OST_LightingFixtures).WhereElementIsNotElementType().ToElements():
    if light.get_Parameter(DB.BuiltInParameter.SKETCH_PLANE_PARAM):  # если рабочая плоскость не None (проверь строку)
        # мощность светильника
        parameter = doc.GetElement(light.GetTypeId()).LookupParameter('БУДОВА_Активная мощность')  # получили мощность светильника во внутренних единицах
        unit = parameter.GetUnitTypeId()
        power = DB.UnitUtils.ConvertFromInternalUnits(parameter.AsDouble(), unit)  # конвертировали мощность светильника во внешние единицы/как на экране пользователя
        # группа светильника
        group = light.LookupParameter('БУДОВА_Группа').AsString()  # получили имя группы
        # этаж светильника
        level = light.LookupParameter('БУДОВА_Уровень оборудования').AsString()  # получили уровень оборудования
    # мощность светильников по "группа.этаж"
        if group + '.' + level not in mag_light_sum_power:
            mag_light_sum_power[group + '.' + level] = [0.0]
    # просуммировали мощность в каждой "группе.этаже" перевели в кВт
        mag_sum = mag_light_sum_power[group + '.' + level].pop() + power / 1000  # просуммировали мощность в каждой группе.этаже, перевели в кВт
        mag_light_sum_power[group + '.' + level].append(mag_sum)
# OUT = mag_light_sum_power

# ПРОВЕРКА цепи в имени которых есть "гр", у которых классификация нагрузок не освещение
koef_circuit = 1.05  # коэффициент запаса на длину цепи

mag_group_sum_circuit = {}  # словарь сумм длин магистралей по группам
mag_sechenie = {}
for el_circuit in FEC(doc).OfCategory(DB.BuiltInCategory.OST_ElectricalCircuit).ToElements():
    if not el_circuit.LookupParameter('БУДОВА_Классификация нагрузок').AsElementId().IntegerValue == -1:
        if doc.GetElement(el_circuit.LookupParameter('БУДОВА_Классификация нагрузок').AsElementId()).Name == 'Освещение':
            if 'гр' in el_circuit.Name:
                # circuit_cl.append(el_circuit.Name)
            # Будова_Этаж (str)
                # circuit_cl.append(el_circuit.LookupParameter('БУДОВА_Этаж').AsString())
            # БУДОВА_Признак цепи (str) отделили коэффициенты стояков от магистралей 
                if 'магистраль' in el_circuit.LookupParameter('БУДОВА_Признак цепи').AsString():
                    parameter = el_circuit.Parameter[DB.BuiltInParameter.RBS_ELEC_CIRCUIT_LENGTH_PARAM]  # Длина цепи полная
                    unit = parameter.GetUnitTypeId()
                    leng = DB.UnitUtils.ConvertFromInternalUnits(parameter.AsDouble(), unit)  # конвертировали длину цепи во внешние единицы/как на экране пользователя
                    leng_with_koef = koef_circuit * leng  # длина цепи с коэффициентом запаса
                    # Коэффициент длины для dU (не полная длина):
                    str_mag = el_circuit.LookupParameter('БУДОВА_Признак цепи').AsString()[:2]  # два первых символа для коэф длины при расчете dU
                    group_c = el_circuit.LookupParameter('БУДОВА_Группа').AsString()
                    # имя уровня пaнели, к которой подключена цепь
                    level = doc.GetElement(el_circuit.BaseEquipment.Id).Host.Name[1:3]
                    if group_c + '.' + level not in mag_group_sum_circuit:
                        mag_group_sum_circuit[group_c + '.' + level] = [0]
                    mag_sum = mag_group_sum_circuit[group_c + '.' + level].pop() + ((float(str_mag[0] + '.' + str_mag[1]) / 1000) * leng_with_koef)
                    # Длина магистралей для dU (коэффициент запаса и коэффициент из празнака цепи):
                    mag_group_sum_circuit[group_c + '.' + level].append(mag_sum)  # float(str_mag[0] + '.' + str_mag[1]) - это коэф получающийся из строки признака цепи

                # Тип кабеля (str) (ВВГнг 3х2,5)
                    type_cbel = doc.GetElement(el_circuit.LookupParameter('Тип кабеля').AsElementId()).Name
                # Сечение кабеля (str) Ищет 'х' на русском. Заменили запятую на точку. Перевели в число (пример: 2.5)
                    el = type_cbel.rfind('х') + 1
                    if el != -1:
                        if group_c + '.' + level not in mag_sechenie:
                            mag_sechenie[group_c + '.' + level] = []
                        mag_sechenie[group_c + '.' + level].append(float(type_cbel[el:].replace(',', '.')))
# OUT = mag_group_sum_circuit


moment_magistraley = {}
dU_magistraley = {}
for key in mag_group_sum_circuit.keys():
    if key in mag_light_sum_power:
        if key not in dU_magistraley:
            dU_magistraley[key] = []
        dU_magistraley[key].append((mag_light_sum_power[key][0] * mag_group_sum_circuit[key][0]) / 12 / mag_sechenie[key][0])
        if key not in moment_magistraley:
            moment_magistraley[key] = []
        moment_magistraley[key].append(mag_light_sum_power[key][0] * mag_group_sum_circuit[key][0])
# из списка магистралей/цепей

# OUT = dU_magistraley
# OUT = circuit_cl
# OUT = mag_sechenie
# OUT = mag_light_sum_power
# OUT = mag_group_sum_circuit

# Отобрали по глобальному имени группы dU магистралей (чтоб потом выбрать из них максимальную)
# получили список разных значений в одной группе
dU_magistraley_global = {}
for key, value in dU_magistraley.items():
    if (key[:key.rfind(".")]) not in dU_magistraley_global:
        dU_magistraley_global[key[:key.rfind(".")]] = []
    dU_magistraley_global[key[:key.rfind(".")]].append(value[0])

# OUT = dU_magistraley_global


# Отобрали по глобальному имени группы моменты магистралей (чтоб потом выбрать из них максимальный)
# получили список разных значений в одной группе

moment_magistraley_global = {}
for key, value in moment_magistraley.items():
    if (key[:key.rfind(".")]) not in moment_magistraley_global:
        moment_magistraley_global[key[:key.rfind(".")]] = []
    moment_magistraley_global[key[:key.rfind(".")]].append(value[0])

# OUT = moment_magistraley_global

# Отобрали максимальные значения dU магистралей (наибольшую dU из всех этажей)
dU_magistraley_global_max = {}
for key, value in dU_magistraley_global.items():
    dU_magistraley_global_max[key] = sorted(value)[-1:]

# OUT = dU_magistraley_global_max


# Отобрали максимальные значения моментов магистралей (наибольший момент из всех этажей)
moment_magistraley_global_max = {}
for key, value in moment_magistraley_global.items():
    moment_magistraley_global_max[key] = sorted(value)[-1:]

# OUT = moment_magistraley_global_max

OUT = dU_magistraley_global_max, moment_magistraley_global_max
# ----------------------------------------

# group: dU стояков + dU магистралей сюда вошли и группы магистралей у которых нет признака "стояк" сюда не вошли группы, у которых нагрузка не светильник, здесь только светильники IN[0] - dU стояков IN[1] - dU магистралей по этажам
словарь_du_стояков = CodeBlock(a=python_script) { a[0]; }
словарь_du_магистралей = CodeBlock(a=python_script_2) { a[0]; }
python_script_3 = Python(IN[0]=словарь_du_стояков, IN[1]=словарь_du_магистралей)  # IronPython2
# ---------- python_script_3.python (27 lines) ----------
# -*- coding: utf-8 -*
# dU стояков + dU магистралей
import clr
clr.AddReference('RevitAPI')
clr.AddReference('RevitServices')  # Работа с документом и транзакциями
from Autodesk.Revit import DB
from Autodesk.Revit.DB import FilteredElementCollector as FEC
from RevitServices.Persistence import DocumentManager as DM  # Менеджер документа

doc = DM.Instance.CurrentDBDocument # Получение файла документа


dU_stoyakov = IN[0]
dU_magistraley_on_level = IN[1]

sum_dU_stoy_and_dU_mag = {}

# округлено до ближайшего большего десятичного  + 0.05
for key_group, value_dU in dU_magistraley_on_level.items():
    if key_group not in sum_dU_stoy_and_dU_mag:
        sum_dU_stoy_and_dU_mag[key_group] = []
    if key_group in dU_stoyakov:
        sum_dU_stoy_and_dU_mag[key_group].append(str(round((dU_stoyakov[key_group][0] + value_dU[0]) + 0.05, 1)))
    else:
        sum_dU_stoy_and_dU_mag[key_group].append(str(round((dU_magistraley_on_level[key_group][0]) + 0.05, 1)))

OUT = sum_dU_stoy_and_dU_mag
# ----------------------------------------
count = DesignScript.Builtin.Dictionary.Count(dictionary=словарь_du_стояков)
count_2 = DesignScript.Builtin.Dictionary.Count(dictionary=словарь_du_магистралей)
count_3 = DesignScript.Builtin.Dictionary.Count(dictionary=python_script_3)

# group: dU линий моменты линий
python_script_4 = Python()  # IronPython2; unwired: IN[0]
# ---------- python_script_4.python (103 lines) ----------
# -*- coding: utf-8 -*
# dU линий по этажам
import clr
clr.AddReference('RevitAPI')
clr.AddReference('RevitServices')  # Работа с документом и транзакциями
from Autodesk.Revit import DB
from Autodesk.Revit.DB import FilteredElementCollector as FEC
from RevitServices.Persistence import DocumentManager as DM  # Менеджер документа

doc = DM.Instance.CurrentDBDocument # Получение файла документа

line_light_sum_power = {}

for light in FEC(doc).OfCategory(DB.BuiltInCategory.OST_LightingFixtures).WhereElementIsNotElementType().ToElements():
    if light.get_Parameter(DB.BuiltInParameter.SKETCH_PLANE_PARAM):  # если рабочая плоскость не None (проверь строку)
        # мощность светильника
        parameter = doc.GetElement(light.GetTypeId()).LookupParameter('БУДОВА_Активная мощность')  # получили мощность светильника во внутренних единицах
        unit = parameter.GetUnitTypeId()
        power = DB.UnitUtils.ConvertFromInternalUnits(parameter.AsDouble(), unit)  # конвертировали мощность светильника во внешние единицы/как на экране пользователя
        # группа светильника
        group = light.LookupParameter('БУДОВА_Группа').AsString()  # получили имя группы
        # этаж светильника
        level = light.LookupParameter('БУДОВА_Уровень оборудования').AsString()  # получили уровень оборудования
    # мощность светильников по "группа.этаж"
        if group not in line_light_sum_power:
            line_light_sum_power[group] = [0.0]
    # просуммировали мощность в каждой "группе.этаже" перевели в кВт
        line_sum = line_light_sum_power[group].pop() + power / 1000  # просуммировали мощность в каждой группе.этаже, перевели в кВт
        line_light_sum_power[group].append(line_sum)
# OUT = line_light_sum_power

# ПРОВЕРКА цепи в имени которых есть "гр", у которых классификация нагрузок не освещение
koef_circuit = 1.05  # коэффициент запаса на длину цепи

dU_line_group_circuit = {}  # словарь сумм длин линий по группам
line_sechenie = {}
for el_circuit in FEC(doc).OfCategory(DB.BuiltInCategory.OST_ElectricalCircuit).ToElements():
    if not el_circuit.LookupParameter('БУДОВА_Классификация нагрузок').AsElementId().IntegerValue == -1:
        if doc.GetElement(el_circuit.LookupParameter('БУДОВА_Классификация нагрузок').AsElementId()).Name == 'Освещение':
            if 'гр' in el_circuit.Name:
                # circuit_cl.append(el_circuit.Name)
            # Будова_Этаж (str)
                # circuit_cl.append(el_circuit.LookupParameter('БУДОВА_Этаж').AsString())
            # БУДОВА_Признак цепи (str) отделили коэффициенты стояков от линий 
                if 'линия' in el_circuit.LookupParameter('БУДОВА_Признак цепи').AsString():
                    parameter = el_circuit.Parameter[DB.BuiltInParameter.RBS_ELEC_CIRCUIT_LENGTH_PARAM]  # Длина цепи полная
                    unit = parameter.GetUnitTypeId()
                    leng = DB.UnitUtils.ConvertFromInternalUnits(parameter.AsDouble(), unit)  # конвертировали длину цепи во внешние единицы/как на экране пользователя
                    leng_with_koef = koef_circuit * leng  # длина цепи с коэффициентом запаса
                    # Коэффициент длины для dU (не полная длина):
                    str_mag = el_circuit.LookupParameter('БУДОВА_Признак цепи').AsString()[:2]  # два первых символа для коэф длины при расчете dU
                    group_c = el_circuit.LookupParameter('БУДОВА_Группа').AsString()
                    # dU_lines_global[key[:key.rfind(".")]] = []
                    # group_c.rfind(".") - возвращает индекс последней точки в строке group_c
                    # if group_c[:group_c.rfind(".")] not in dU_line_group_circuit:
                    #     dU_line_group_circuit[group_c[:group_c.rfind(".")]] = [0]
                    # line_sum = dU_line_group_circuit[group_c[:group_c.rfind(".")]].pop() + ((float(str_mag[0] + '.' + str_mag[1]) / 1000) * leng_with_koef)
                    # # Длина линий для dU (коэффициент запаса и коэффициент из празнака цепи):
                    # dU_line_group_circuit[group_c[:group_c.rfind(".")]].append(line_sum)  # float(str_mag[0] + '.' + str_mag[1]) - это коэф получающийся из строки признака цепи
                # # Тип кабеля (str) (ВВГнг 3х2,5)
                #     type_cbel = doc.GetElement(el_circuit.LookupParameter('Тип кабеля').AsElementId()).Name
                # # Сечение кабеля (str) Ищет 'х' на русском. Заменили запятую на точку. Перевели в число (пример: 2.5)
                #     el = type_cbel.rfind('х') + 1
                #     if el != -1:
                #         if group_c[:group_c.rfind(".")] not in line_sechenie:
                #             line_sechenie[group_c[:group_c.rfind(".")]] = []
                #         line_sechenie[group_c[:group_c.rfind(".")]].append(float(type_cbel[el:].replace(',', '.')))
                    if group_c not in dU_line_group_circuit:
                        dU_line_group_circuit[group_c] = [0]
                    line_sum = dU_line_group_circuit[group_c].pop() + ((float(str_mag[0] + '.' + str_mag[1]) / 1000) * leng_with_koef)
                    # Длина линий для dU (коэффициент запаса и коэффициент из празнака цепи):
                    dU_line_group_circuit[group_c].append(line_sum)  # float(str_mag[0] + '.' + str_mag[1]) - это коэф получающийся из строки признака цепи

                # Тип кабеля (str) (ВВГнг 3х2,5)
                    type_cbel = doc.GetElement(el_circuit.LookupParameter('Тип кабеля').AsElementId()).Name
                # Сечение кабеля (str) Ищет 'х' на русском. Заменили запятую на точку. Перевели в число (пример: 2.5)
                    el = type_cbel.rfind('х') + 1
                    if el != -1:
                        if group_c not in line_sechenie:
                            line_sechenie[group_c] = []
                        line_sechenie[group_c].append(float(type_cbel[el:].replace(',', '.')))
# OUT = dU_line_group_circuit


moment_lines = {}
dU_lines = {}
for key in dU_line_group_circuit.keys():
    if key in line_light_sum_power:
        if key not in dU_lines:
            dU_lines[key] = []
        dU_lines[key].append(str(round((line_light_sum_power[key][0] * dU_line_group_circuit[key][0] / 12 / line_sechenie[key][0]) + 0.05, 1)))
        if key not in moment_lines:
            moment_lines[key] = []
        moment_lines[key].append(str(round((line_light_sum_power[key][0] * dU_line_group_circuit[key][0]) + 0.5, 0))[:-2])
# из списка линий/цепей

# OUT = dU_lines
# OUT = circuit_cl
# OUT = line_sechenie
# OUT = line_light_sum_power
# OUT = dU_line_group_circuit

OUT = dU_lines, moment_lines
# ----------------------------------------
du_линий = CodeBlock(a=python_script_4) { a[0]; }
моменты_линий = CodeBlock(a=python_script_4) { a[1]; }

# group: dU группы стояк/магистраль и линия объединены в один словарь
keys = DesignScript.Builtin.Dictionary.Keys(dictionary=du_линий)
valueAtKey = DesignScript.Builtin.Dictionary.ValueAtKey(dictionary=du_линий, key=keys)
setValueAtKeys = DesignScript.Builtin.Dictionary.SetValueAtKeys(dictionary=python_script_3, keys=keys, values=valueAtKey)

# group: получили ключи для извлечения всех данных
keys_2 = DesignScript.Builtin.Dictionary.Keys(dictionary=setValueAtKeys)

# group: Сортировка аварийных и рабочих групп в списке
сортировка_групп_в_списке = Python(IN[0]=keys_2)  # IronPython2
# ---------- сортировка_групп_в_списке.python (17 lines) ----------
# -*- coding: utf-8 -*
# dU_sort_string_in_list

# функция преобразует в целое число цифры из строки
# для строк типа "гр.11А", "гр.5"
def int_in_string(string):
    if 'А' in string:
        return int(string[3:len(string)-1])
    if 'А' not in string:
        return int(string[3:len(string)])

lt_s = IN[0]

# сортируем список по двум критериям
# первый - по содержанию 'А' в строке
# второй - по целым числам в строке (выбрали из строки из сделали целыми числами)
OUT = sorted(lt_s, key=lambda string: ('А' in string, int_in_string(string)))
# ----------------------------------------

# group: Выводы Моменты, которые здесь посчитаны неправильно, не учтены стояк-магистраль макисимальный, моменты используй из dU
python_script_5 = Python()  # IronPython2; unwired: IN[0]
# ---------- python_script_5.python (100 lines) ----------
# -*- coding: utf-8 -*
# dU выводы
import clr
clr.AddReference('RevitAPI')
clr.AddReference('RevitServices')  # Работа с документом и транзакциями
from Autodesk.Revit import DB
from Autodesk.Revit.DB import FilteredElementCollector as FEC
from RevitServices.Persistence import DocumentManager as DM  # Менеджер документа

doc = DM.Instance.CurrentDBDocument # Получение файла документа

power_group = {}
cos_light = {}

for light in FEC(doc).OfCategory(DB.BuiltInCategory.OST_LightingFixtures).WhereElementIsNotElementType().ToElements():
    if light.get_Parameter(DB.BuiltInParameter.SKETCH_PLANE_PARAM):  # если рабочая плоскость не None (проверь строку)
        # мощность светильника
        parameter = doc.GetElement(light.GetTypeId()).LookupParameter('БУДОВА_Активная мощность')  # получили мощность светильника во внутренних единицах
        unit = parameter.GetUnitTypeId()
        power = DB.UnitUtils.ConvertFromInternalUnits(parameter.AsDouble(), unit)  # конвертировали мощность светильника во внешние единицы/как на экране пользователя
        # группа светильника
        group = light.LookupParameter('БУДОВА_Группа').AsString()  # получили имя группы
        # этаж светильника
        # level = light.LookupParameter('БУДОВА_Уровень оборудования').AsString()  # получили уровень оборудования
    # мощность светильников по "группа.этаж"
        if group not in power_group:
            power_group[group] = [0.0]
    # просуммировали мощность в каждой "группе.этаже" перевели в кВт
        mag_sum = power_group[group].pop() + power / 1000  # просуммировали мощность в каждой группе.этаже, перевели в кВт
        power_group[group].append(mag_sum)
        # коэффициент мощности светильника (cos f)
        cos = doc.GetElement(light.GetTypeId()).LookupParameter('БУДОВА_Коэффициент мощности').AsDouble()  # получили мощность светильника во внутренних единицах
        if group not in cos_light:
            cos_light[group] = []
        cos_light[group].append(cos)
# OUT = power_group
# OUT = cos_light

# Средневзвешенный косинус всей группы светильников
cos_light_center = {}
for key, value in cos_light.items():
    if key not in cos_light_center:
        cos_light_center[key] = round(sum(value) / len(value), 2)
# OUT = cos_light_center

# Ток всей группы светильников
tok_group = {}
for key, value in power_group.items():
    if key not in tok_group:
        # округление до ближайшего большего ( + 0.5) целого
        tok_group[key] = round(((value[0] / 0.22 / cos_light_center[key]) + 0.5), 0)
# OUT = tok_group


# ПРОВЕРКА цепи в имени которых есть "гр", у которых классификация нагрузок не освещение
koef_circuit = 1.05  # коэффициент запаса на длину цепи

sum_len_circuit = {}  # словарь сумм полных длин по группам
type_cabel = {}
for el_circuit in FEC(doc).OfCategory(DB.BuiltInCategory.OST_ElectricalCircuit).ToElements():
    if not el_circuit.LookupParameter('БУДОВА_Классификация нагрузок').AsElementId().IntegerValue == -1:
        if doc.GetElement(el_circuit.LookupParameter('БУДОВА_Классификация нагрузок').AsElementId()).Name == 'Освещение':
            if 'гр' in el_circuit.Name:
                        # circuit_cl.append(el_circuit.Name)
                        # Будова_Этаж (str)
                        # circuit_cl.append(el_circuit.LookupParameter('БУДОВА_Этаж').AsString())
                        # БУДОВА_Признак цепи (str) отделили коэффициенты стояков от магистралей
                gl_group_c = el_circuit.LookupParameter('БУДОВА_Группа').AsString()
                # gl_group_c = group_c[:group_c.rfind(".")]
                # if gl_group_c not in sum_len_circuit:
                #     sum_len_circuit[gl_group_c] = [0.0]
                if gl_group_c not in sum_len_circuit:
                    sum_len_circuit[gl_group_c] = [0.0]
                parameter = el_circuit.Parameter[DB.BuiltInParameter.RBS_ELEC_CIRCUIT_LENGTH_PARAM]  # Длина цепи полная
                unit = parameter.GetUnitTypeId()
                leng = DB.UnitUtils.ConvertFromInternalUnits(parameter.AsDouble(), unit)  # конвертировали длину цепи во внешние единицы/как на экране пользователя
                leng_with_koef = koef_circuit * leng  # длина цепи с коэффициентом запаса
                # Суммируем в словаре значения длин цепей  "+ 0.5" - округление до ближайшего большего целого (с Ревитом совпало полностью!!!):
                sum_circuit = sum_len_circuit[gl_group_c].pop() + round(((leng_with_koef / 1000) + 0.5), 0)
                sum_len_circuit[gl_group_c].append(sum_circuit)

                # Тип кабеля (str) (ВВГнг 3х2,5)
                type_cbel = doc.GetElement(el_circuit.LookupParameter('Тип кабеля').AsElementId()).Name
                if gl_group_c not in type_cabel:
                    type_cabel[gl_group_c] = []
                # Добавляем только уникальные типы кабеля в список
                if type_cbel not in type_cabel[gl_group_c]:
                    type_cabel[gl_group_c].append(type_cbel)
# OUT = sum_len_circuit
# OUT = type_cabel

# Момент всей группы светильников
moment_group = {}
for key, value in power_group.items():
    if key not in moment_group:
        # округление до ближайшего большего ( + 0.5) целого
        moment_group[key] = round(((value[0] / 0.22 / cos_light_center[key]) + 0.5), 0)
# OUT = moment_group

OUT = power_group, cos_light_center, tok_group, sum_len_circuit, moment_group, type_cabel
# ----------------------------------------

# group: Мощность
P = CodeBlock(a=python_script_5) { a[0]; }
р_python_script = Python(IN[0]=P)  # IronPython2
# ---------- р_python_script.python (22 lines) ----------
# -*- coding: utf-8 -*
# dU строки округления для мощности
import clr
clr.AddReference('RevitAPI')
clr.AddReference('RevitServices')  # Работа с документом и транзакциями
from Autodesk.Revit import DB
from Autodesk.Revit.DB import FilteredElementCollector as FEC
from RevitServices.Persistence import DocumentManager as DM  # Менеджер документа

doc = DM.Instance.CurrentDBDocument # Получение файла документа


in_dict = IN[0]

out_dict = {}

# округлено до ближайшего большего сотого  + 0.005
for key, value in in_dict.items():
    if key not in out_dict:
    	out_dict[key] = str(round((value[0] + 0.005), 2))

OUT = out_dict
# ----------------------------------------
valueAtKey_2 = DesignScript.Builtin.Dictionary.ValueAtKey(dictionary=р_python_script, key=сортировка_групп_в_списке)

# group: cos f
cos_f = CodeBlock(a=python_script_5) { a[1]; }
cos_f_dictionary_valueatkey = DesignScript.Builtin.Dictionary.ValueAtKey(dictionary=cos_f, key=сортировка_групп_в_списке)

# group: Ток
I = CodeBlock(a=python_script_5) { a[2]; }
valueAtKey_3 = DesignScript.Builtin.Dictionary.ValueAtKey(dictionary=I, key=сортировка_групп_в_списке)

# group: Длины групп Тотальная длина группы
L = CodeBlock(a=python_script_5) { a[3]; }
l_python_script = Python(IN[0]=L)  # IronPython2
# ---------- l_python_script.python (21 lines) ----------
# -*- coding: utf-8 -*
# dU строки округления для длин
import clr
clr.AddReference('RevitAPI')
clr.AddReference('RevitServices')  # Работа с документом и транзакциями
from Autodesk.Revit import DB
from Autodesk.Revit.DB import FilteredElementCollector as FEC
from RevitServices.Persistence import DocumentManager as DM  # Менеджер документа

doc = DM.Instance.CurrentDBDocument # Получение файла документа


in_dict = IN[0]

out_dict = {}

for key, value in in_dict.items():
    if key not in out_dict:
    	out_dict[key] = str(round(value[0], 0))[:-2]

OUT = out_dict
# ----------------------------------------
valueAtKey_4 = DesignScript.Builtin.Dictionary.ValueAtKey(dictionary=l_python_script, key=сортировка_групп_в_списке)

# group: Создание пустой ячейки для Excel
code_block = CodeBlock { ""; }
count_4 = List.Count(list=сортировка_групп_в_списке)
cycle = List.Cycle(list=code_block, amount=count_4)

# group: моменты стояков + моменты магистралей здесь только те группы, у которых есть как признак "магисталь" так и признак "стояк", из магистралей выбирается максимальная и суммируется со стояком "магистраль" должны иметь только те группы, копии которых есть на разных этажах, все остальные группы должны иметь признак "линия" сюда не вошли группы, у которых нагрузка не светильник, здесь только светильники IN[0] - моменты стояков IN[1] - моменты магистралей по этажам
словарь_моментов_стояков = CodeBlock(a=python_script) { a[1]; }
словарь_моментов_магистралей = CodeBlock(a=python_script_2) { a[1]; }
python_script_6 = Python(IN[0]=словарь_моментов_стояков, IN[1]=словарь_моментов_магистралей)  # IronPython2
# ---------- python_script_6.python (26 lines) ----------
# -*- coding: utf-8 -*
# dU моменты стояков + моменты магистралей
import clr
clr.AddReference('RevitAPI')
clr.AddReference('RevitServices')  # Работа с документом и транзакциями
from Autodesk.Revit import DB
from Autodesk.Revit.DB import FilteredElementCollector as FEC
from RevitServices.Persistence import DocumentManager as DM  # Менеджер документа

doc = DM.Instance.CurrentDBDocument # Получение файла документа

moment_stoyakov = IN[0]
moment_magistraley_on_level = IN[1]

sum_moment_stoy_and_moment_mag = {}

# округлено до ближайшего большего целого  + 0.5
for key_group, value_moment in moment_magistraley_on_level.items():
    if key_group not in sum_moment_stoy_and_moment_mag:
        sum_moment_stoy_and_moment_mag[key_group] = []
    if key_group in moment_stoyakov:
        sum_moment_stoy_and_moment_mag[key_group].append(str(round((moment_stoyakov[key_group][0] + value_moment[0]) + 0.5, 0))[:-2])
    else:
        sum_moment_stoy_and_moment_mag[key_group].append(str(round((moment_magistraley_on_level[key_group][0]) + 0.5, 0))[:-2])

OUT = sum_moment_stoy_and_moment_mag
# ----------------------------------------

# group: Моменты группы стояк/магистраль и линия объединены в один словарь
keys_3 = DesignScript.Builtin.Dictionary.Keys(dictionary=моменты_линий)
valueAtKey_5 = DesignScript.Builtin.Dictionary.ValueAtKey(dictionary=моменты_линий, key=keys_3)
setValueAtKeys_2 = DesignScript.Builtin.Dictionary.SetValueAtKeys(dictionary=python_script_6, keys=keys_3, values=valueAtKey_5)

# group: избавились от списков в значениях
р_python_script_2 = Python(IN[0]=setValueAtKeys_2)  # IronPython2
# ---------- р_python_script_2.python (22 lines) ----------
# -*- coding: utf-8 -*

import clr
clr.AddReference('RevitAPI')
clr.AddReference('RevitServices')  # Работа с документом и транзакциями
from Autodesk.Revit import DB
from Autodesk.Revit.DB import FilteredElementCollector as FEC
from RevitServices.Persistence import DocumentManager as DM  # Менеджер документа

doc = DM.Instance.CurrentDBDocument # Получение файла документа


in_dict = IN[0]

out_dict = {}

# округлено до ближайшего большего сотого  + 0.005
for key, value in in_dict.items():
    if key not in out_dict:
    	out_dict[key] = value[0]

OUT = out_dict
# ----------------------------------------

valueAtKey_6 = DesignScript.Builtin.Dictionary.ValueAtKey(dictionary=р_python_script_2, key=сортировка_групп_в_списке)

# group: избавились от списков в значениях
р_python_script_3 = Python(IN[0]=setValueAtKeys)  # IronPython2; same code as р_python_script_2

valueAtKey_7 = DesignScript.Builtin.Dictionary.ValueAtKey(dictionary=р_python_script_3, key=сортировка_групп_в_списке)

# group: Тип кабеля
cabel = CodeBlock(a=python_script_5) { a[5]; }
cabel_python_script = Python(IN[0]=cabel)  # IronPython2
# ---------- cabel_python_script.python (22 lines) ----------
# -*- coding: utf-8 -*
# dU строки округления для типа кабеля
import clr
clr.AddReference('RevitAPI')
clr.AddReference('RevitServices')  # Работа с документом и транзакциями
from Autodesk.Revit import DB
from Autodesk.Revit.DB import FilteredElementCollector as FEC
from RevitServices.Persistence import DocumentManager as DM  # Менеджер документа

doc = DM.Instance.CurrentDBDocument # Получение файла документа


in_dict = IN[0]

out_dict = {}

# округлено до ближайшего большего сотого  + 0.005
for key, value in in_dict.items():
    if key not in out_dict:
    	out_dict[key] = value[0]

OUT = out_dict
# ----------------------------------------
valueAtKey_8 = DesignScript.Builtin.Dictionary.ValueAtKey(dictionary=cabel_python_script, key=сортировка_групп_в_списке)

code_block_2 = CodeBlock(empt=cycle, M=valueAtKey_6, dU=valueAtKey_7, cabel=valueAtKey_8) { [empt,M,dU,cabel]; }

# group: Подготовка данных для записи в Excel
code_block_3 = CodeBlock(group=сортировка_групп_в_списке, P=valueAtKey_2, cosf=cos_f_dictionary_valueatkey, I=valueAtKey_3, L=valueAtKey_4) { [group,P,cosf,I,L]; }
transpose = List.Transpose(lists=code_block_3)
transpose_2 = List.Transpose(lists=code_block_2)
code_block_4 = CodeBlock(a=transpose, b=transpose_2) { [a,b]; }
transpose_3 = List.Transpose(lists=code_block_4)
code_block_5 = CodeBlock { 1; }
flatten = List.Flatten(list=transpose_3, amt=code_block_5)

# group: вывод данных в Excel
now = DateTime.Now()
code_block_6 = CodeBlock { "dd.MM.yy_hhmm"; }
format = DateTime.Format(dateTime=now, format=code_block_6)
code_block_7 = CodeBlock { 0; }
boolean_2 = BoolSelector(true)
exportExcel = Data.ExportExcel(filePath=путь_к_файлу_excel_для_вывода, sheetName=format, startRow=code_block_7, startCol=code_block_7, data=flatten, overWrite=boolean_2)

# group: Группы, которые должны были быть промаркированы как "линия" или для них не проложен стояк. Которые есть в магистралях, но их нет в стояках
python_script_7 = Python(IN[0]=словарь_du_стояков, IN[1]=словарь_du_магистралей)  # IronPython2
# ---------- python_script_7.python (26 lines) ----------
# -*- coding: utf-8 -*
# dU из магистралей вычли стояки
import clr
clr.AddReference('RevitAPI')
clr.AddReference('RevitServices')  # Работа с документом и транзакциями
from Autodesk.Revit import DB
from Autodesk.Revit.DB import FilteredElementCollector as FEC
from RevitServices.Persistence import DocumentManager as DM  # Менеджер документа

doc = DM.Instance.CurrentDBDocument # Получение файла документа


# СТОЯКИ НА IN[0], МАГИСТРАЛИ НА IN[1]

# из ключей словаря стояков вычли ключи словаря магистралей и так узнали
# какая группа промаркированная как "магистраль" не имеет стояка,
# то есть должна была бы быть промаркирована как "линия"
dU_stoyakov = IN[0]
dU_magistraley_on_level = IN[1]

list_stoy = set([group for group in dU_stoyakov.keys()])
list_mag = set([group for group in dU_magistraley_on_level.keys()])

# группы, которые должны были быть промаркированы как "линия" или не проложен для них стояк,
# которые есть в магистралях, но их нет в стояках
OUT = list_mag - list_stoy
# ----------------------------------------
code_block_8 = CodeBlock(w=python_script_7) { w; }

# group: Группы, которые должны были быть промаркированы как "линия" или для них не проложен стояк. Которые есть в магистралях, но их нет в стояках
python_script_8 = Python(IN[0]=словарь_моментов_стояков, IN[1]=словарь_моментов_магистралей)  # IronPython2; same code as python_script_7
code_block_9 = CodeBlock(w=python_script_8) { w; }

count_5 = DesignScript.Builtin.Dictionary.Count(dictionary=python_script_6)
