# Dynamo graph without_table_excel_to_revit.dyn (Dynamo 2.10.1.3976)

# group: Здесь еще старые скрипты без отбрасывания нулей в целых числах и без замены точек на запятые в целых числах
code_block = CodeBlock { _viewSchedule: var[]..[]; }  # unwired: viewSchedule
code_block_2 = CodeBlock { _data: var[]..[]; }  # unwired: data
code_block_3 = CodeBlock { _parameterNames: var[]..[]; }  # unwired: parameterNames
python_script = Python(IN[0]=code_block, IN[1]=code_block_2, IN[2]=code_block_3)  # IronPython2; frozen
# ---------- python_script.python (69 lines) ----------
#Copyright(c) 2015, Konrad Sobon
# @arch_laboratory, http://archi-lab.net

import clr
clr.AddReference('ProtoGeometry')
from Autodesk.DesignScript.Geometry import *

# Import DocumentManager and TransactionManager
clr.AddReference("RevitServices")
import RevitServices
from RevitServices.Persistence import DocumentManager
from RevitServices.Transactions import TransactionManager

# Import RevitAPI
clr.AddReference("RevitAPI")
import Autodesk
from Autodesk.Revit.DB import *

doc = DocumentManager.Instance.CurrentDBDocument
uiapp = DocumentManager.Instance.CurrentUIApplication
app = uiapp.Application

from System.Collections.Generic import *

# Import ToDSType(bool) extension method
clr.AddReference("RevitNodes")
import Revit
clr.ImportExtensions(Revit.Elements)

#The inputs to this node will be stored as a list in the IN variable.
dataEnteringNode = IN

keySchedule = UnwrapElement(IN[0])
data = IN[1]
inputParams = IN[2]

# "Start" the transaction
TransactionManager.Instance.EnsureInTransaction(doc)

test = []
count = []
cellParams = [[] for i in range(len(data))]
if any(isinstance(item, list) for item in data):
	# process list of lists
	for i in data:
		count.append(len(i))
	colCount = max(count)
	colAvailable = len(keySchedule.Definition.GetSchedulableFields())
	if colCount > colAvailable:
		message = "Please add/remove parameters to/from schedule so that they match longest data set."
	else:
		tableData = keySchedule.GetTableData()
		sectionData = tableData.GetSectionData(SectionType.Body)
		if sectionData.NumberOfRows - 2 <= len(data):
			# schedule by default will have 2 rows (A, B, C and Header Names)
			rowsToAdd = (len(data) - sectionData.NumberOfRows) + 2
			for i in range(0, rowsToAdd, 1):
				sectionData.InsertRow(0)
		else:
			# schedule when updating might already have too many rows 
			rowsToDelete = sectionData.NumberOfRows - 2 - len(data)
			for i in reversed(range(sectionData.NumberOfRows - rowsToDelete, sectionData.NumberOfRows, 1)):
				sectionData.RemoveRow(i)

# "End" the transaction
TransactionManager.Instance.TransactionTaskDone()

#Assign your output to the OUT variable
OUT = keySchedule
# ----------------------------------------
code_block_4 = CodeBlock { _upperCase: bool = false; }
python_script_2 = Python(IN[0]=python_script, IN[1]=code_block_2, IN[2]=code_block_3, IN[3]=code_block_4)  # IronPython2
# ---------- python_script_2.python (85 lines) ----------
#Copyright(c) 2015, Konrad Sobon
# @arch_laboratory, http://archi-lab.net

import clr
import sys
clr.AddReference('ProtoGeometry')
from Autodesk.DesignScript.Geometry import *

# Import DocumentManager and TransactionManager
clr.AddReference("RevitServices")
import RevitServices
from RevitServices.Persistence import DocumentManager
from RevitServices.Transactions import TransactionManager

# Import RevitAPI
clr.AddReference("RevitAPI")
import Autodesk
from Autodesk.Revit.DB import *

doc = DocumentManager.Instance.CurrentDBDocument
uiapp = DocumentManager.Instance.CurrentUIApplication
app = uiapp.Application

from System.Collections.Generic import *

# Import ToDSType(bool) extension method
clr.AddReference("RevitNodes")
import Revit
clr.ImportExtensions(Revit.Elements)

pyt_path = r'C:\Program Files (x86)\IronPython 2.7\Lib'
sys.path.append(pyt_path)
import re

#The inputs to this node will be stored as a list in the IN variable.
dataEnteringNode = IN

keySchedule = UnwrapElement(IN[0])
data = IN[1]
inputParams = IN[2]
upper = IN[3]

# "Start" the transaction
TransactionManager.Instance.EnsureInTransaction(doc)

tableData = keySchedule.GetTableData()
sectionData = tableData.GetSectionData(SectionType.Body)

keyNames = []
for i in range(1,sectionData.NumberOfRows - 1,1):
	keyNames.append(str(int(i)))

allKeys = FilteredElementCollector(doc).WhereElementIsNotElementType()
params = [[] for i in range(len(keyNames))]
test = []
for key in allKeys:
	try:
		if key.get_Parameter(BuiltInParameter.REF_TABLE_ELEM_NAME).AsString() in keyNames and key.OwnerViewId == keySchedule.Id:
			indexValue = keyNames.index(key.get_Parameter(BuiltInParameter.REF_TABLE_ELEM_NAME).AsString())
			for i in range(0, len(inputParams),1):
				params[indexValue].extend(key.GetParameters(str(inputParams[i])))
	except:
		pass

for i, j in zip(params, data):
	for param, value in zip(i,j):
		if isinstance(value, str):
			valueDecoded = value.decode('string_escape')
		else:
			if value == None:
				valueDecoded = " "
			else:
				valueDecoded = str(value).decode('string_escape')
		if upper:
			valueDecoded = valueDecoded.upper()
			param.Set(valueDecoded)
		else:
			param.Set(valueDecoded)


# "End" the transaction
TransactionManager.Instance.TransactionTaskDone()

#Assign your output to the OUT variable
OUT = keySchedule
# ----------------------------------------
code_block_5 = CodeBlock(viewSchedule=python_script_2) { _viewSchedule; }

# group: перключите, чтоб сработал скрипт повторно
boolean = BoolSelector(true)

# group: выбираем ключевую спецификацию в списке видов
python_script_3 = Python(IN[1]=boolean)  # IronPython2; unwired: IN[0]
# ---------- python_script_3.python (14 lines) ----------
# -*- coding: utf-8 -*
import clr
clr.AddReference('RevitServices')
from RevitServices.Persistence import DocumentManager as DM

clr.AddReference('RevitAPI')
from Autodesk.Revit import DB
from Autodesk.Revit.DB import FilteredElementCollector as FEC

doc = DM.Instance.CurrentDBDocument

list_view = [view for view in FEC(doc).OfClass(DB.ViewSchedule) if 'Таблица расчета нагрузок' in view.Title]

OUT = list_view[0]
# ----------------------------------------

file_path = Filename("..\Расчеты\Подсчет квартир\Варненская,9 подсчет квартир.xlsx")
file_from_path = FileObject(path=file_path)
string = StringInput("in revit")
importExcel = Data.ImportExcel(file=file_from_path, sheetName=string)

# group: удалили первый элемент списка, - удалили строку заглавия таблицы
restOfItems = List.RestOfItems(list=importExcel)

# group: список имен параметров, должно быть точное совпадение имени иначе не будет найден параметр и он не заполнится
code_block_6 = CodeBlock { ["№ п/п","Наименование потребителя","Установленная мощность, кВт","Кс","соs φ","Расчетная мощность, кВт","Расчетный ток, А"]; }

# group: заполнение ключевой спецификации
code_block_7 = CodeBlock(viewSchedule=python_script_3) { _viewSchedule; }
code_block_8 = CodeBlock(data=restOfItems) { _data; }
code_block_9 = CodeBlock(parameterNames=code_block_6) { _parameterNames; }
python_script_4 = Python(IN[0]=code_block_7, IN[1]=code_block_8, IN[2]=code_block_9)  # IronPython2
# ---------- python_script_4.python (66 lines) ----------
# -*- coding: utf-8 -*
import clr
clr.AddReference('ProtoGeometry')
from Autodesk.DesignScript.Geometry import *

# Import DocumentManager and TransactionManager
clr.AddReference("RevitServices")
import RevitServices
from RevitServices.Persistence import DocumentManager
from RevitServices.Transactions import TransactionManager

# Import RevitAPI
clr.AddReference("RevitAPI")
import Autodesk
from Autodesk.Revit.DB import *

doc = DocumentManager.Instance.CurrentDBDocument
uiapp = DocumentManager.Instance.CurrentUIApplication
app = uiapp.Application

from System.Collections.Generic import *

# импорт ToDSType(bool) метода расширения
clr.AddReference("RevitNodes")
import Revit
clr.ImportExtensions(Revit.Elements)

#Входные данные этого узла будут сохранены в виде списка в переменной IN
dataEnteringNode = IN

keySchedule = UnwrapElement(IN[0])
data = IN[1]
inputParams = IN[2]

# "Start" the transaction
TransactionManager.Instance.EnsureInTransaction(doc)

test = []
count = []
cellParams = [[] for i in range(len(data))]
if any(isinstance(item, list) for item in data):
	# process list of lists (процесс список списков)
	for i in data:
		count.append(len(i))
	colCount = max(count)
	colAvailable = len(keySchedule.Definition.GetSchedulableFields())
	if colCount > colAvailable:
		# Добавьте/удалите параметры в/из спецификацию, чтобы они соответствовали самому длинному набору данных.
		message = "Please add/remove parameters to/from schedule so that they match longest data set."
	else:
		tableData = keySchedule.GetTableData()
		sectionData = tableData.GetSectionData(SectionType.Body)
		if sectionData.NumberOfRows - 2 <= len(data):
			# спецификация по умолчанию будет иметь 2 строки (A, B, C и Header Names)
			rowsToAdd = (len(data) - sectionData.NumberOfRows) + 2
			for i in range(0, rowsToAdd, 1):
				sectionData.InsertRow(0)
		else:
			# спецификация при обновлении может иметь слишком много строк
			rowsToDelete = sectionData.NumberOfRows - 2 - len(data)
			for i in reversed(range(sectionData.NumberOfRows - rowsToDelete, sectionData.NumberOfRows, 1)):
				sectionData.RemoveRow(i)

TransactionManager.Instance.TransactionTaskDone()

OUT = keySchedule
# ----------------------------------------
# note: можно все буквы преобразовать в капслук, по умолчанию false = без преобразования
code_block_10 = CodeBlock { _upperCase: bool = false; }
python_script_5 = Python(IN[0]=python_script_4, IN[1]=code_block_8, IN[2]=code_block_9, IN[3]=code_block_10)  # IronPython2
# ---------- python_script_5.python (85 lines) ----------
# -*- coding: utf-8 -*
import clr
import sys
clr.AddReference('ProtoGeometry')
from Autodesk.DesignScript.Geometry import *

# импорт DocumentManager and TransactionManager
clr.AddReference("RevitServices")
import RevitServices
from RevitServices.Persistence import DocumentManager
from RevitServices.Transactions import TransactionManager

# импорт RevitAPI
clr.AddReference("RevitAPI")
import Autodesk
from Autodesk.Revit.DB import *

doc = DocumentManager.Instance.CurrentDBDocument
uiapp = DocumentManager.Instance.CurrentUIApplication
app = uiapp.Application

from System.Collections.Generic import *

# импорт ToDSType(bool) метода расширения
clr.AddReference("RevitNodes")
import Revit
clr.ImportExtensions(Revit.Elements)

pyt_path = r'C:\Program Files (x86)\IronPython 2.7\Lib'
sys.path.append(pyt_path)
import re

# Входные данные этого узла будут сохранены в виде списка в переменной IN
dataEnteringNode = IN

keySchedule = UnwrapElement(IN[0])
data = IN[1]
inputParams = IN[2]
upper = IN[3]

TransactionManager.Instance.EnsureInTransaction(doc)

tableData = keySchedule.GetTableData()
sectionData = tableData.GetSectionData(SectionType.Body)

keyNames = []
for i in range(1,sectionData.NumberOfRows - 1,1):
	keyNames.append(str(int(i)))

allKeys = FilteredElementCollector(doc).WhereElementIsNotElementType()
params = [[] for i in range(len(keyNames))]
test = []
for key in allKeys:
	try:
		if key.get_Parameter(BuiltInParameter.REF_TABLE_ELEM_NAME).AsString() in keyNames and key.OwnerViewId == keySchedule.Id:
			indexValue = keyNames.index(key.get_Parameter(BuiltInParameter.REF_TABLE_ELEM_NAME).AsString())
			for i in range(0, len(inputParams),1):
				params[indexValue].extend(key.GetParameters(str(inputParams[i])))
	except:
		pass

for i, j in zip(params, data):
	for param, value in zip(i,j):
		if isinstance(value, str):
			valueDecoded = value.decode('string_escape')
		else:
			if value == None:
				valueDecoded = " "
			else:
				valueDecoded = str(value).decode('string_escape')
		if upper:
			valueDecoded = valueDecoded.upper()
			param.Set(valueDecoded)
		else:
			# при декодировании в целых числах получаются нули
			# если в значении есть '.0' и '.0' в конце значения, то удаляем последних два символа(.0)
			# точки заменяем на запятые
			if '.0' in valueDecoded and valueDecoded[-2:] == '.0':
				param.Set(valueDecoded[:-2].replace('.', ','))
			else:
				param.Set(valueDecoded.replace('.', ','))

TransactionManager.Instance.TransactionTaskDone()

OUT = keySchedule
# ----------------------------------------
