# Dynamo graph without_text_top_bottom_levels.dyn (Dynamo 2.10.1.3976)

# note: модуль main нужно расположить в той же папке, что и этот файл Dynamo, тогда можно указывать не полный путь, а только имя модуля/файла
string = StringInput("078_09_text_top_bottom_ level.py")

# group: полный путь к файлу, если файл не расположен в той же папке что этот файл Dynamo
# note: здесь указан полный путь расположения файла main. Букву r перед строкой ставить не нужно (для невоспринятия спецсимволов)
string_2 = StringInput("D:\Андрей\Ревит\Курс Погружение в IronPython и Revit API\3 Базовые действия в Revit API\3.4  Основные виды геометрии в Revit API\3.4 Видео\main.py")  # frozen
file_from_path = FileObject(path=string_2)
readText = FileSystem.ReadText(file=file_from_path)
python_script_from_string = PythonStringNode(script=readText, IN[0]=file_from_path)  # IronPython2

# group: получили имя текущего документа Dynamo и зменили расширение .dyn на .py
python_script = Python()  # IronPython2; unwired: IN[0]
# ---------- python_script.python (40 lines) ----------
"""
DYNAMOAPI: GET CURRENT WORKSPACE NAME
"""
__author__ = 'John Pierson - sixtysecondrevit@gmail.com'
__twitter__ = '@60secondrevit'
__github__ = '@sixtysecondrevit'
__version__ = '1.0.0'
"""
Using reflection we are able to obtain the current Dynamo instance from the Revit instance.
"""
# we need to import the common language runtime to be able to interact with Dynamo & Revit

# Importing Reference Modules
# CLR ( Common Language Runtime Module )
import clr
# Adding the DynamoRevitDS.dll module to work with the Dynamo API
clr.AddReference('DynamoRevitDS')
import Dynamo 

# access to the current Dynamo instance and workspace
dynamoRevit = Dynamo.Applications.DynamoRevit()
currentWorkspace = dynamoRevit.RevitDynamoModel.CurrentWorkspace

# Access current version of dynamo
version=dynamoRevit.RevitDynamoModel.Version

# checks version of dynamo and adjusts output according to version
if version.StartsWith("1."):
    
    # Gets file name which includes full path
    filename=currentWorkspace.FileName
    
    # Splits out file path to just file name
    OUT=filename.Split("\\")[-1].Replace(".dyn","")

elif version.StartsWith("2."):
    OUT=currentWorkspace.Name+".py"

else:
    OUT="Not supported"
# ----------------------------------------

# note: здесь получили текст скрипта  файла main редактируемого в VSCode
file_from_path_2 = FileObject(path=python_script)
readText_2 = FileSystem.ReadText(file=file_from_path_2)
boolean = BoolSelector(false)
python_script_from_string_2 = PythonStringNode(script=readText_2, IN[0]=file_from_path_2, IN[1]=boolean)  # IronPython2
type = Object.Type(obj=python_script_from_string_2)
извлечение_по_ключу_из_словаря = CodeBlock(a=python_script_from_string_2) { a["LU100"]; }
извлечение_по_ключу_из_словаря_2 = CodeBlock(a=python_script_from_string_2) { a[1]["гр.6"]; }  # "извлечение по ключу из словаря вывод из нескольких словарей"
isNull = Object.IsNull(object=python_script_from_string_2)
code_block = CodeBlock { true; }
allIndicesOf = List.AllIndicesOf(list=isNull, item=code_block)
code_block_2 = CodeBlock(a=allIndicesOf) { a-1; }
getItemAtIndex = List.GetItemAtIndex(list=python_script_from_string_2, index=code_block_2)
извлечение_по_ключу_из_словаря_3 = CodeBlock(a=python_script_from_string_2) { a["L0200"]; }
извлечение_по_ключу_из_словаря_4 = CodeBlock(a=python_script_from_string_2) { a["LR100"]; }
sort = List.Sort(list=python_script_from_string_2)
извлечение_по_ключу_из_словаря_5 = CodeBlock(a=python_script_from_string_2) { a["L0100"]; }
code_block_3 = CodeBlock(a=python_script_from_string_2) { a[0]; }
извлечение_по_ключу_из_словаря_6 = CodeBlock(a=code_block_3) { a["LU100"]; }
извлечение_по_ключу_из_словаря_7 = CodeBlock(a=code_block_3) { a["L0100"]; }
code_block_4 = CodeBlock(a=python_script_from_string_2) { a[1]; }
извлечение_по_ключу_из_словаря_8 = CodeBlock(a=code_block_4) { a["L0100"]; }
извлечение_по_ключу_из_словаря_9 = CodeBlock(a=code_block_4) { a["LU100"]; }
извлечение_по_ключу_из_словаря_10 = CodeBlock(a=code_block_3) { a["L0200"]; }
извлечение_по_ключу_из_словаря_11 = CodeBlock(a=code_block_4) { a["L0200"]; }
извлечение_по_ключу_из_словаря_12 = CodeBlock(a=code_block_3) { a["L0300"]; }
извлечение_по_ключу_из_словаря_13 = CodeBlock(a=code_block_4) { a["L0300"]; }
извлечение_по_ключу_из_словаря_14 = CodeBlock(a=code_block_3) { a["L1500"]; }
извлечение_по_ключу_из_словаря_15 = CodeBlock(a=code_block_4) { a["L1500"]; }
извлечение_по_ключу_из_словаря_16 = CodeBlock(a=code_block_3) { a["L1500"]; }
извлечение_по_ключу_из_словаря_17 = CodeBlock(a=code_block_4) { a["L1500"]; }
извлечение_по_ключу_из_словаря_18 = CodeBlock(a=code_block_3) { a["LT100"]; }
извлечение_по_ключу_из_словаря_19 = CodeBlock(a=code_block_4) { a["LT100"]; }
извлечение_по_ключу_из_словаря_20 = CodeBlock(a=code_block_3) { a["LR100"]; }
извлечение_по_ключу_из_словаря_21 = CodeBlock(a=code_block_4) { a["LR100"]; }
